# Grasshopper definition addition.ghx (Grasshopper 1.0.7)

add = Addition()
addition = Addition()
num = Number(addition)
timestwo = GhPythonScript(x=num)  # -> a
# ---------- timestwo: Python ----------
a = x*2
# ---------- end timestwo ----------
additionresult = Number(num)
result = Data([timestwo, additionresult])
panel = Panel(additionresult)
panel_2 = Panel(result)
