# Grasshopper definition delay.ghx (Grasshopper 1.0.7)

# ----
# Some inputs
# to set
# no delay
# delay 1s
inputb = GhPythonScript(b=0)  # -> out, b
# ---------- inputb: Python ----------
import time

time.sleep(1)
b=-b
# ---------- end inputb ----------

inputa = GhPythonScript(a=0)  # -> out, a
# ---------- inputa: Python ----------
a=-a
# ---------- end inputa ----------

# ----
# Some very heavy computation
# delay 5s
calc = GhPythonScript(a=inputa.a, b=inputb.b)  # -> out, c
# ---------- calc: Python ----------
import time


time.sleep(5)

c = a+b
# ---------- end calc ----------

# ----
# Data to collect
resultc = Data(calc.c)

panel = Panel(resultc)
