# Grasshopper definition inputs.ghx (Grasshopper 1.0.7)

input_list = ValueList({"duck", "cat"}, selected="duck")  # disabled
input_slider = Slider(0.25, range=0..1)  # disabled
input_panel = Panel("")  # disabled
# set a single value
# to different types of components
input_num = Number()
input_bool = Boolean()
input_python = GhPythonScript()  # -> pt
# ---------- input_python: Python ----------
a=x

import Rhino.Geometry as rg

pt = rg.Point3d(x,x,x)
# ---------- end input_python ----------
input_txt = Text()
input_int = Integer()
output_data = Data([input_num, input_int, input_txt, input_bool, input_slider, input_list, input_panel, input_python])
panel = Panel(output_data)
